# Grasshopper definition ROOM_Planer_Test.gh (Grasshopper 1.0.4)

# ---- group: Create data for your rooms
# 1- ID = Room ID in RoomInstanse
# 2 - Room name
# 3 - Room area(int)
# 4 - true/false - Enabled room
number_slider = Slider(1, range=0..1)
number_slider_2 = Slider(9, range=0..100)
txt = Text("GOOD_ROOM__")
subtraction = Subtraction(A=number_slider_2, B="1")
series = Series(Start=number_slider, Step=Slider(1, range=0..1), Count=number_slider_2)
dom = ConstructDomain(DomainStart=number_slider, DomainEnd=number_slider_2)
random = Random(Range=Domain(0, 1), Number=number_slider_2, Seed=Slider(0, range=0..100))
range = Range(Domain=Domain(0, 1), Steps=subtraction)
random_2 = Random(Range=dom, Number=number_slider_2, Seed=2)
concat = Concatenate(FragmentA=txt, FragmentB=series)
smaller = SmallerThan(FirstNumber=range, SecondNumber=random)  # -> SmallerThan, OrEqualTo
int = Integer(random_2)
flip = FlipMatrix(Data=concat)
flip_2 = FlipMatrix(Data=series)
flip_3 = FlipMatrix(Data=int)
flip_4 = FlipMatrix(Data=smaller.SmallerThan)
weave = Weave(Pattern=[0, 1, 2, 3], Stream0=flip_2, Stream1=flip, Stream2=flip_3, Stream3=flip_4, NullGaps=False)

# ----
panel = Panel(weave)
